vi "And.gvi"   [LabVIEW NXG 5.0.0]
inputs:
  "A": bool
  "B": bool
outputs:
  "Output": bool
uses:
  Hack::Nand.gvi
  Hack::Not.gvi
diagram:
  # $A: a
  # $B: b
  # w1: s0
  call "Nand.gvi"(A=$A, B=$B) -> (Output=w1)
  call "Not.gvi"(Input=w1) -> (Output=w2)
  # w2: out
  $Output <- w2
