vi "DFF.gvi"   [LabVIEW NXG 5.0.0]
inputs:
  "Input": bool
  "Clock": bool
outputs:
  "Output": bool
diagram:
  # w1: clock(t-1)
  Feedback Node(input=$Clock) -> w1
  # $Input: input(t)
  Is Greater(x=$Clock, y=w1) -> w2
  # w3: input(t-l)
  Feedback Node(enable?=w2, input=$Input) -> w3
  $Output <- w3
