vi "Mux.gvi"   [LabVIEW NXG 5.0.0]
inputs:
  "Selector": bool
  "A": bool
  "B": bool
outputs:
  "Output": bool
uses:
  Hack::And.gvi
  Hack::Not.gvi
  Hack::Or.gvi
diagram:
  # $Selector: selector
  # $B: b
  # w1: s2
  call "And.gvi"(A=$Selector, B=$B) -> (Output=w1)
  # $A: a
  # w2: s0
  call "Not.gvi"(Input=$Selector) -> (Output=w2)
  # w3: s1
  call "And.gvi"(A=$A, B=w2) -> (Output=w3)
  call "Or.gvi"(A=w3, B=w1) -> (Output=w4)
  # w4: output
  $Output <- w4
