vi "Or.gvi"   [LabVIEW NXG 5.0.0]
inputs:
  "A": bool
  "B": bool
outputs:
  "Output": bool
uses:
  Hack::Not.gvi
  Hack::Nand.gvi
diagram:
  # $B: b
  # w1: s1
  call "Not.gvi"(Input=$B) -> (Output=w1)
  # $A: a
  # w2: s0
  call "Not.gvi"(Input=$A) -> (Output=w2)
  call "Nand.gvi"(A=w2, B=w1) -> (Output=w3)
  # w3: output
  $Output <- w3
