vi "Or8Way.gvi"   [LabVIEW NXG 5.0.0]
uses:
  Hack::Or.gvi
diagram:
  call "Or.gvi"() -> (Output=w1)
  call "Or.gvi"() -> (Output=w2)
  # w1: s0
  # w2: s1
  call "Or.gvi"(A=w1, B=w2) -> (Output=w3)
  call "Or.gvi"() -> (Output=w4)
  call "Or.gvi"() -> (Output=w5)
  # w4: s2
  # w5: s3
  call "Or.gvi"(A=w4, B=w5) -> (Output=w6)
  # w3: s4
  # w6: s5
  call "Or.gvi"(A=w3, B=w6)
